# Grasshopper definition test.gh (Grasshopper 1.0.7)
# Spherical spikey thing

# ---- group: RH_IN:Count
number_slider = Slider(3, range=1..10)

# ---- group: RH_IN:Radius
cell_radius = Slider(10, range=0..10)

# ---- group: RH_IN:explode
bool = Boolean(False)

# ----
pt = ConstructPoint(XCoordinate=0, YCoordinate=0, ZCoordinate=0)
msphere = MeshSphere(Base=pt, Radius=cell_radius, UCount=10, VCount=20)
scale = Scale(Geometry=msphere, Center=Point(0, 0, 0), Factor=number_slider)  # -> Geometry, Transform
scale_2 = Scale(Geometry=scale.Geometry, Center=Point(0, 0, 0), Factor=number_slider)  # -> Geometry, Transform
filter = StreamFilter(Gate=bool, Stream0=scale.Geometry, Stream1=scale_2.Geometry)
c_script = CSharpScript(mesh=filter)  # -> base64Draco; inputs mesh: Mesh
# ---------- c_script: C# ----------
    var options = new Rhino.FileIO.DracoCompressionOptions();
    options.CompressionLevel = 5;
    options.IncludeTextureCoordinates = false;
    options.IncludeVertexColors = false;

    var compressed = Rhino.FileIO.DracoCompression.Compress(mesh, options);
    base64Draco = compressed.ToBase64String();
# ---------- end c_script ----------
preview = CustomPreview(Geometry=filter, Material=ColourSwatch(SwatchColor=RGB(255, 20, 20)))

# ---- group: RH_OUT:Mesh
txt = Text(c_script)
